# Grasshopper definition ELJ_env.gh (Grasshopper 1.0.7)
# plug-ins: HoopSnake, DeCodingSpaces, Kangaroo2 Components, Dodo, Pufferfish

# ---- group: RH_IN:action
int = Integer()

# ---- group: RH_IN:reset
bool = Boolean()

# ----
loop = BooleanToggle(False)
environment = GhPythonScript(action=int, reset=bool)  # -> out, simplify(grid_world), simplify(color_state), observation, reward, done, info; inputs action: Int32, reset: Boolean
# ---------- environment: Python ----------
"""Implementation of an RL environment class based on 
the 'Beady Ring' model (Hillier & Hanson, 1984).
    Inputs:
        x: The x script variable
        y: The y script variable
    Output:
        a: The a output variable"""

import random
from math import floor
import scriptcontext as sc
import ghpythonlib.components as ghcomp
import ghpythonlib.treehelpers as th


class BeadyRing_env:
    def __init__(self):
        self._carrier_color = 127.5
        self._house_color = 0
        self._street_color = 255
        self._cell_size = 3
        self._max_row_len = 36
        self._obs_size = 3
        self.pad = int(floor(self._obs_size/2))
        self.max_world_row_len = int(self._max_row_len + 2*self.pad)
        self.iter = 0
        
        # grid world
        xy_plane = ghcomp.XYPlane(ghcomp.ConstructPoint(0, 0, 0))
        cell, _ = ghcomp.Rectangle(xy_plane, self._cell_size, self._cell_size, 0)
        
        r_max = self._cell_size * self.max_world_row_len
        move_range = [i for i in range(0, r_max, self._cell_size)]
        
        y_vec = ghcomp.UnitY(move_range)
        cell_col, _ = ghcomp.Move(cell, y_vec)
        
        x_vec = ghcomp.UnitX(move_range)
        grid_world = []
        for c in cell_col:
            cell_row, _ = ghcomp.Move(c, x_vec)
            grid_world.append(cell_row)
        
        self.grid_world = ghcomp.ReverseList(grid_world)
        
        # initial location
        self.R = int(floor(self.max_world_row_len/2))
        self.C = int(floor(self.max_world_row_len/2))
        
        self.x = self.R - self.pad
        self.y = self.C - self.pad
        
        self.cell = [self.x, self.y]
        self.adjacent_cells = [[self.x, self.y]]
        self.adj_cells = [[self.x, self.y]]
        
        # initial state
        self.state = [[self._carrier_color for _ in range(int(self.max_world_row_len))] 
                        for _ in range(int(self.max_world_row_len))]
        
        # initial observation
        self.observation = self.get_obs()

    def step(self, _cell_state):
        self.iter += 1
        # update state step
        self.state[self.R][self.C] = 255*_cell_state
        
        for i, a in enumerate(self.adj_cells):
            if a == self.cell:
                del self.adj_cells[i]
        
        adjacent = self.get_adjacent()
        
        # reward
        reward = 0
        adj_street_count = 0
        
        for a in adjacent:
            if int(self.state[a[0] + self.pad][a[1] + self.pad]) == 255:
                adj_street_count += 1
        
        if _cell_state == 1:
            # density metric
            reward -= 1/(self._max_row_len**2)
            if adj_street_count >= 3:
                reward -= 1
            elif adj_street_count == 0:
                reward -= 1
        elif _cell_state == 0:
            if adj_street_count == 0:
                reward -= 1
            elif adj_street_count >= 3:
                reward -= 1
        
        for item in adjacent:
            if item not in self.adjacent_cells:
                self.adjacent_cells.append(item)
                self.adj_cells.append(item)
        
        # done
        done = False
        if len(self.adj_cells) == 0:
            done = True
        elif len(self.adj_cells) > 0:
            # next action location selection
            self.cell = random.choice(self.adj_cells)
            
            self.x = self.cell[0]
            self.y = self.cell[1]
            
            self.R = self.x + self.pad
            self.C = self.y + self.pad
        
        # observation
        self.observation = self.get_obs()
        
        return self.observation, reward, done, {}

    def reset(self):
        # initial state
        self.state = [[self._carrier_color for _ in range(int(self.max_world_row_len))] 
                        for _ in range(int(self.max_world_row_len))]
        
        # reset step counter
        self.iter = 0
        
        # initial location
        self.R = int(floor(self.max_world_row_len/2))
        self.C = int(floor(self.max_world_row_len/2))
        
        self.x = self.R - self.pad
        self.y = self.C - self.pad
        
        self.cell = [self.x, self.y]
        self.adjacent_cells = [[self.x, self.y]]
        self.adj_cells = [[self.x, self.y]]
        
        # initial observation
        self.observation = self.get_obs()
        
        return self.observation

    def render(self):
        # state visualization
        color_state = [ghcomp.ColourRGB(255, self.state[i], self.state[i], 
                        self.state[i]) for i in range(self.max_world_row_len)]
        return color_state

    def get_obs(self):
        # observation
        left_up_R = int(self.R - self.pad)
        left_up_C = int(self.C - self.pad)
        right_bottom_R = int(self.R + self.pad)
        right_bottom_C = int(self.C + self.pad)
        obs_ = []
        for i in range(left_up_R, right_bottom_R + 1):
            obs_row = []
            for j in range(left_up_C, right_bottom_C + 1):
                item = self.state[i][j]
                obs_row.append(item)
            obs_.append(obs_row)
        return obs_

    def get_adjacent(self):
        # von Neumann neighbourhood
        adjacent = []
        if self.x < self._max_row_len - 1:
            adjacent.append([self.x+1, self.y])
        if self.y > 0:
            adjacent.append([self.x, self.y-1])
        if self.x > 0:
            adjacent.append([self.x-1, self.y])
        if self.y < self._max_row_len - 1:
            adjacent.append([self.x, self.y+1])
        return adjacent

if 'env' not in globals():
    env = BeadyRing_env()
    sc.sticky['env'] = env

if reset:
    observation = sc.sticky['env'].reset()
    observation = th.list_to_tree(observation, source=[0,0])
    reward = None
    done = False
    info = {}
    grid_world_ = th.list_to_tree(sc.sticky['env'].grid_world, source=[0,0])
    color_state = sc.sticky['env'].render()
    color_state_ = th.list_to_tree(color_state, source=[0,0])
    
elif action is not None:
    observation, reward, done, info = sc.sticky['env'].step(action)
    observation = th.list_to_tree(observation, source=[0,0])
    reward = th.list_to_tree(reward, source=[0,0])
    done = th.list_to_tree(done, source=[0,0])
    info = th.list_to_tree(info, source=[0,0])
    grid_world_ = th.list_to_tree(sc.sticky['env'].grid_world, source=[0,0])
    color_state = sc.sticky['env'].render()
    color_state_ = th.list_to_tree(color_state, source=[0,0])
    
else:
    raise RuntimeError("Either reset or action must be provided")
# ---------- end environment ----------
render = BooleanToggle(False)
environment_2 = GhPythonScript(loop=loop)  # -> out; inputs loop: Boolean
# ---------- environment_2: Python ----------
"""Implementation of an RL environment class based on 
the 'Beady Ring' model (Hillier & Hanson, 1984).
    Inputs:
        x: The x script variable
        y: The y script variable
    Output:
        a: The a output variable"""

import random
from math import floor
import socket
import struct
import pickle
import scriptcontext as sc
import ghpythonlib.components as ghcomp
import ghpythonlib.treehelpers as th


class Connection:
    def __init__(self, s):
        self._socket = s
        self._buffer = ""

    def receive_object(self):
        while len(self._buffer) < 4 or len(self._buffer) < struct.unpack("<L", self._buffer[:4])[0] + 4:
            new_bytes = self._socket.recv(16)
            if len(new_bytes) == 0:
                return None
            self._buffer += new_bytes
        length = struct.unpack("<L", self._buffer[:4])[0]
        header, body = self._buffer[:4], self._buffer[4:length + 4]
        obj = pickle.loads(body)
        self._buffer = self._buffer[length + 4:]
        return obj

    def send_object(self, d):
        body = pickle.dumps(d)
        header = struct.pack("<L", len(body))
        msg = header + body
        self._socket.send(msg)

class EricksonLJ_env:
    def __init__(self):
        self._carrier_color = 127.5
        self._house_color = 0
        self._street_color = 255
        self._cell_size = 3
        self._max_row_len = 36
        self._obs_size = 37
        self._3d = False
        self.pad = int(floor(self._obs_size/2))
        self.max_world_row_len = int(self._max_row_len + 2*self.pad)
        self.iter = 0
        
        # grid world
        xy_plane = ghcomp.XYPlane(ghcomp.ConstructPoint(0, 0, 0))
        cell, _ = ghcomp.Rectangle(xy_plane, self._cell_size, self._cell_size, 0)
        
        r_max = self._cell_size * self.max_world_row_len
        move_range = [i for i in range(0, r_max, self._cell_size)]
        
        y_vec = ghcomp.UnitY(move_range)
        cell_col, _ = ghcomp.Move(cell, y_vec)
        
        x_vec = ghcomp.UnitX(move_range)
        grid_world = []
        for c in cell_col:
            cell_row, _ = ghcomp.Move(c, x_vec)
            grid_world.append(cell_row)
        
        self.grid_world = ghcomp.ReverseList(grid_world)
        
        # initial location
        self.R = int(floor(self.max_world_row_len/2))
        self.C = int(floor(self.max_world_row_len/2))
        
        R_space = [r for r in range(int(self.pad), int(self._max_row_len + self.pad))]
        C_space = [c for c in range(int(self.pad), int(self._max_row_len + self.pad))]
        self.RC_space = [[[r, c] for c in C_space] for r in R_space]
        
        self.x = self.R - self.pad
        self.y = self.C - self.pad
        
        self.cell = [[self.x, self.y], [self.R, self.C]]
        self.adjacent_cells = [[[self.x, self.y], [self.R, self.C]]]
        self.adj_cells = [[[self.x, self.y], [self.R, self.C]]]
        
        # initial state
        self.state = [[self._carrier_color for _ in range(int(self.max_world_row_len))] 
                        for _ in range(int(self.max_world_row_len))]
        
        # initial observation
        self.observation = self.get_obs()

    def step(self, _cell_state):
        self.iter += 1
        # update state step
        self.state[self.R][self.C] = 255*_cell_state
        
        for i, a in enumerate(self.adj_cells):
            if a == self.cell:
                del self.adj_cells[i]
        
        adjacent = self.get_adjacent()
        
        # reward
        reward = 0
        adj_street_count = 0
        
        for a in adjacent:
            if int(self.state[a[1][0]][a[1][1]]) == 255:
                adj_street_count += 1
        
        if _cell_state == 1:
            # density metric
            reward -= 1/(self._max_row_len**2)
            if adj_street_count >= 3:
                reward -= 1
            elif adj_street_count == 0:
                reward -= 1
        elif _cell_state == 0:
            if adj_street_count == 0:
                reward -= 1
            elif adj_street_count >= 3:
                reward -= 1
        
        for item in adjacent:
            if item not in self.adjacent_cells:
                self.adjacent_cells.append(item)
                self.adj_cells.append(item)
        
        # done
        done = False
        if len(self.adj_cells) == 0:
            done = True
        elif len(self.adj_cells) > 0:
            # next action location selection
            self.cell = random.choice(self.adj_cells)
            
            self.x = self.cell[0][0]
            self.y = self.cell[0][1]
            
            self.R = self.cell[1][0]
            self.C = self.cell[1][1]
        
        # observation
        self.observation = self.get_obs()
        
        return self.observation, reward, done, {}

    def reset(self):
        # initial state
        self.state = [[self._carrier_color for _ in range(int(self.max_world_row_len))] 
                        for _ in range(int(self.max_world_row_len))]
        
        # reset step counter
        self.iter = 0
        
        # initial location
        self.R = int(floor(self.max_world_row_len/2))
        self.C = int(floor(self.max_world_row_len/2))
        
        self.x = self.R - self.pad
        self.y = self.C - self.pad
        
        self.cell = [[self.x, self.y], [self.R, self.C]]
        self.adjacent_cells = [[[self.x, self.y], [self.R, self.C]]]
        self.adj_cells = [[[self.x, self.y], [self.R, self.C]]]
        
        # initial observation
        self.observation = self.get_obs()
        
        return self.observation

    def render(self):
        # state visualization
        color_state = [ghcomp.ColourRGB(255, self.state[i], self.state[i], 
                        self.state[i]) for i in range(self.max_world_row_len)]
        return color_state

    def get_obs(self):
        # observation
        left_up_R = int(self.R - self.pad)
        left_up_C = int(self.C - self.pad)
        right_bottom_R = int(self.R + self.pad)
        right_bottom_C = int(self.C + self.pad)
        obs_ = []
        for i in range(left_up_R, right_bottom_R + 1):
            obs_row = []
            for j in range(left_up_C, right_bottom_C + 1):
                item = self.state[i][j]
                obs_row.append(item)
            obs_.append(obs_row)
        return obs_

    def get_adjacent(self):
        # von Neumann neighbourhood
        adjacent = []
        if self.x < len(self.RC_space) - 1:
            adjacent.append([[self.x+1, self.y], self.RC_space[self.x+1][self.y]])
        if self.y > 0:
            adjacent.append([[self.x, self.y-1], self.RC_space[self.x][self.y-1]])
        if self.x > 0:
            adjacent.append([[self.x-1, self.y], self.RC_space[self.x-1][self.y]])
        if self.y < len(self.RC_space[self.x]) - 1:
            adjacent.append([[self.x, self.y+1], self.RC_space[self.x][self.y+1]])
        return adjacent

    def get_house_cells(self):
        ## house cells
        house_cells_ = []
        for i in range(self.max_world_row_len):
            for j in range(self.max_world_row_len):
                if self.state[i][j] == 0:
                    house_cells_.append(self.grid_world[i][j])
        return house_cells_

if loop:
    # Create environment instance
    if 'env' not in globals():
        env = BeadyRing_env()
        sc.sticky['env'] = env

    # establish connection with RL agent
    if 'agent_conn' not in globals():
        addr = ("127.0.0.1", 50710)
        agent_socket = socket.socket(socket.AF_INET, socket.SOCK_STREAM)
        agent_socket.connect(addr)
        agent_conn = Connection(agent_socket)

    enabled = True
    iter = 0

    while enabled:

        # Connection
        if iter == 0:
            # Reset
            msg_in = agent_conn.receive_object()
            if msg_in == "reset":
                sc.sticky["observation"] = env.reset()
                sc.sticky["state"] = env.state
                sc.sticky["reward"] = None
                sc.sticky["done"] = False
                sc.sticky["info"] = {}
            else:
                raise RuntimeError("First message must be 'reset'")
        else:
            # Send message
            msg_out = {"state": sc.sticky["state"],
                    "observation": sc.sticky["observation"],
                    "reward": sc.sticky["reward"],
                    "done": sc.sticky["done"],
                    "info": sc.sticky["info"]}
            agent_conn.send_object(msg_out)
            # Receive message
            msg_in = agent_conn.receive_object()
            if msg_in == "reset":
                sc.sticky["observation"] = env.reset()
                sc.sticky["state"] = env.state
                sc.sticky["reward"] = None
                sc.sticky["done"] = False
                sc.sticky["info"] = {}
            elif msg_in == "close":
                env.reset()
                agent_socket.close()
                enabled = False
            else:
                action = msg_in
                sc.sticky["observation"], sc.sticky["reward"], sc.sticky["done"], sc.sticky["info"] = env.step(action)
                sc.sticky["state"] = env.state
        
        iter += 1
# ---------- end environment_2 ----------
selfos_v_0_env = GhPythonScript(step=Toggle(True))  # -> out, street_network, BC, CC, street_cells, house_cells, observation, reward, done, info; inputs step: Boolean
# ---------- selfos_v_0_env: Python ----------
import random
import socket
import struct
import pickle
import scriptcontext as sc
import ghpythonlib.components as ghcomp
import ghpythonlib.treehelpers as th
from statistics import mean


class EricksonLJ_env:
    def __init__(self):
        self._house_color = 0
        self._street_color = 255
        self._cell_size = 3
        self.scalefactor = 2
        self.iter = 0
        
        # initial location
        self.x = 0
        self.y = 0
        
        self.pos = [self.x, self.y]
        self.adjacent_locs = [[self.x, self.y]]
        self.adj_locs = [[self.x, self.y]]
        
        # initial state
        self.cells = []
        self.network = []
        self.BC = []
        self.CC = []
        self.streets = []
        self.nodes = []
        self.houses = []
        self.cell = None
        self.currentPt = ghcomp.ConstructPoint(self.x, self.y, 0)
        self.posPts = []
        self.posPts.append(self.currentPt)
        
        self.cumul_rwd = 0
        
        # initial observation
        self.observation = 0 # self.get_obs()
    
    def step(self, action):
        self.iter += 1
        # update state step
        self.cell = self.make_cell(action[1])
        self.cells.append(self.cell)
        if action[0] == 1:
            self.streets.append(self.cell)
            self.nodes.append(self.currentPt)
        elif action[0] == 0:
            self.houses.append(self.cell)
        else:
            raise ValueError("action value {} is not valid".format(action[0]))
        
        try:
            del self.adj_locs[0]
        except:
            raise RuntimeError("The current action cell must be deleted at each step.")
        
        # deleted = 0
        # for i, a in enumerate(self.adj_locs):
            # if abs(a[0]-self.x)<0.1 and abs(a[1]-self.y)<0.1:
                # del self.adj_locs[i]
                # deleted += 1
        # if deleted == 0:
            # raise RuntimeError("The current action cell must be deleted at each step.")
        
        adjacent, adjacentPts = self.get_adjacent()
        
        # reward
        reward = 0
        if action[0] == 0: # reward if house cell
            reward += 1 # density
        elif action[0] == 1 and len(self.streets) > 1:
            self.update_street_network() 
            res = ghcomp.DecodingSpacesAssembly.CityGraph(path=self.network)
            if isinstance(res['betweenness_centrality'], list):
                self.BC = res['betweenness_centrality']
                reward += mean(self.BC)
                self.CC = res['closeness_centrality']
            else:
                self.BC.append(res['betweenness_centrality'])
                reward += mean(self.BC)
                self.CC.append(res['closeness_centrality'])
        self.cumul_rwd += reward
        
        if action[0] == 1: # Add adjacent cells only if it's a street cell
            handled = 0
            for i, pt in enumerate(adjacentPts):
                handled += 1
                _is_close = False
                distances = ghcomp.Distance(pt, self.posPts)
                if isinstance(distances, list):
                    for distance in distances:
                        if distance < 0.8*self._cell_size:
                            _is_close = True
                            break
                if not _is_close:
                    self.adjacent_locs.append(adjacent[i])
                    self.adj_locs.append(adjacent[i])
                    self.posPts.append(pt) # keep track of all the visited points
            assert handled == len(adjacent), "Only {} adjacent point(s) was/were handled, should be {}".format(handled, len(adjacent))
        
        # done
        done = len(self.adj_locs) == 0
        
        if len(self.adj_locs) > 0:
            # next action location selection
            self.pos = self.adj_locs[0] # random.choice(self.adj_locs)
            
            self.x = self.pos[0]
            self.y = self.pos[1]
            
            self.currentPt = ghcomp.ConstructPoint(self.x, self.y, 0)
        
        # observation
        self.observation = 0 # self.get_obs()
        
        return self.observation, reward, done, {}
    
    def reset(self):
        # reset step counter
        self.iter = 0
        
        # initial location
        self.x = 0
        self.y = 0
        
        self.pos = [self.x, self.y]
        self.adjacent_locs = [[self.x, self.y]]
        self.adj_locs = [[self.x, self.y]]
        
        # initial state
        self.cells = []
        self.network = []
        self.BC = []
        self.CC = []
        self.streets = []
        self.nodes = []
        self.houses = []
        self.cell = None
        self.currentPt = ghcomp.ConstructPoint(self.x, self.y, 0)
        self.posPts = []
        self.posPts.append(self.currentPt)
        
        self.cumul_rwd = 0
        
        # initial observation
        self.observation = 0 # self.get_obs()
        
        return self.observation
    
    def render(self):
        raise NotImplementedError()
    
    def get_obs(self):
        # observation
        raise NotImplementedError()
    
    def get_adjacent(self): 
        # von Neumann neighbourhood
        _, center = ghcomp.Area(self.cell)
        _, edges, _ = ghcomp.DeconstructBrep(self.cell)
        midPts = ghcomp.CurveMiddle(edges)
        vecs, _ = ghcomp.Vector2Pt(center, midPts, True)
        lines = ghcomp.LineSDL(center, vecs, self._cell_size)
        _, endPts = ghcomp.EndPoints(lines)
        adjacent = []
        for pt in endPts:
            x, y, _ = ghcomp.Deconstruct(pt)
            adjacent.append([x, y])
        return adjacent, endPts
    
    def make_cell(self, angle):
        half = self._cell_size/2
        domain = ghcomp.ConstructDomain(-half, half)
        center = ghcomp.ConstructPoint(self.x, self.y, 0)
        cell, _ = ghcomp.Rectangle(center, domain, domain, 0)
        cell, _ = ghcomp.Rotate(cell, ghcomp.Radians(angle), center)
        return cell
    
    def update_street_network(self):
        circle = ghcomp.Circle(self.currentPt, self._cell_size)
        relationship, _ = ghcomp.PointInCurve(self.nodes[:-1], circle)
        pattern = []
        if isinstance(relationship, list):
            pattern = [r != 0 for r in relationship]
        elif isinstance(relationship, int):
            pattern = relationship != 0
        connectedPts = ghcomp.CullPattern(self.nodes[:-1], pattern)
        edges = ghcomp.Line(self.currentPt, connectedPts)
        if isinstance(edges, list):
            for edge in edges:
                self.network.append(edge)
        else:
            if edges is not None:
                self.network.append(edges) 
        if len(self.network) > 1:
            clean_net = ghcomp.Kangaroo2Component.removeDuplicateLines(self.network, 0.01)
            self.network = [item for item in clean_net]


if step:
    # Create environment instance
    if 'env' not in globals():
        env = EricksonLJ_env()
        env.reset()
        sc.sticky['env'] = env
    
    enabled = True
    iter = 0

    while enabled:

        # Connection
        if iter == 0:
            # Reset
            sc.sticky["observation"] = env.reset()
            sc.sticky["reward"] = None
            sc.sticky["done"] = False
            sc.sticky["info"] = {}
        else:
            if sc.sticky["done"] or iter == 1000:
                enabled = False
            else:
                action = [random.randint(0, 1), random.randrange(-30, 30, 5)]
                sc.sticky["observation"], sc.sticky["reward"], sc.sticky["done"], sc.sticky["info"] = env.step(action)
                street_network = th.list_to_tree(env.network, source=[0,0])
                BC = th.list_to_tree(env.BC, source=[0,0])
                CC = th.list_to_tree(env.CC, source=[0,0])
                street_cells_ = th.list_to_tree(env.streets, source=[0,0])
                house_cells_ = th.list_to_tree(env.houses, source=[0,0])
                observation = sc.sticky["observation"]
                reward = env.cumul_rwd
                done = sc.sticky["done"]
                info = sc.sticky["info"]
        
        iter += 1
# ---------- end selfos_v_0_env ----------

# ---- group: RH_OUT:geo
geo = Geometry(environment.grid_world)

# ---- group: RH_OUT:color
num = Number(environment.color_state)

# ---- group: RH_OUT:observation
geo_2 = Geometry(environment.observation)

# ---- group: RH_OUT:reward
num_2 = Number(environment.reward)

# ---- group: RH_OUT:done
bool_2 = Boolean(environment.done)

# ---- group: RH_OUT:info
txt = Text(environment.info)

# ----
srf = Surface(selfos_v_0_env.house_cells)
srf_2 = Surface(selfos_v_0_env.street_cells)
panel = Panel(selfos_v_0_env.observation)
panel_2 = Panel(selfos_v_0_env.reward)
panel_3 = Panel(selfos_v_0_env.done)
preview = CustomPreview(Geometry=srf_2, Material=ColourSwatch(SwatchColor=RGB(237, 35, 50)))
area = Area(Geometry=selfos_v_0_env.street_cells)  # -> Area, Centroid

# ----
# Street Network Generator
number_slider = Slider(3, range=0..10)
cir = Circle(Plane=area.Centroid, Radius=number_slider)
incurve = PointInCurve(Point=area.Centroid, Curve=graft(cir))  # -> Relationship, Point
equals = Equality(FirstNumber=incurve.Relationship, SecondNumber=Slider(0, range=0..100))  # -> Equality, Inequality
cull = CullPattern(List=area.Centroid, CullPattern=equals.Inequality)
ln = Line(StartPoint=graft(area.Centroid), EndPoint=cull)  # -> flatten(Line)
clean = CleanTree(RemoveNulls=True, RemoveInvalid=True, RemoveEmpty=invert(False), Tree=ln)
dupln = RemoveDuplicateLines(Lines=clean, Tolerance=0.01)

join = JoinCurves(Curves=selfos_v_0_env.street_network, Preserve=False)
lng = ListLength(List=srf)
offcrv = OffsetCurve(
    Curve=join,
    Plane=PlaneXY(0, 0, 0),
    Distance=Slider(0.5, range=0..1),
    BothSides=invert(False),
    Kinks=Slider(1, range=0..3),
    CapType=Slider(0, range=0..3))
random = Random(Range=Domain(3, 6), Number=lng, Seed=Slider(63, range=0..100), Integers=True)
Z = UnitZ(Factor=random)
loft = Loft(Curves=offcrv, Options={Adjust=False, Closed=False, LoftEnds=0, LoftSimp=0, LoftType=0, Rebuild=10, Refit=0.01})  # -> flatten(Loft)
extr = Extrude(Base=srf, Direction=Z)
fline = FitLine(Points=area.Centroid)  # disabled
preview_2 = CustomPreview(Geometry=loft, Material=ColourSwatch(SwatchColor=RGB(133, 133, 133)))
sunion = SolidUnion(Breps=extr)
alongcrv = SortAlongCurve(Points=area.Centroid, Curve=fline)  # -> Points, Indices; disabled
nurbs = NurbsCurve(Vertices=alongcrv.Points, Degree=3, Periodic=False)  # -> Curve, Length, Domain; disabled
preview_3 = CustomPreview(Geometry=sunion, Material=ColourSwatch(SwatchColor=RGBA(255, 255, 255, 191)))
panel_4 = Panel("""-.5
.5""")  # disabled
offset = OffsetCurve(Curve=nurbs.Curve, Distance=panel_4, Plane=PlaneXY(0, 0, 0), Corners=1)  # -> flatten(Curve); disabled
loft_2 = Loft(Curves=offset, Options={Adjust=False, Closed=False, LoftEnds=0, LoftSimp=0, LoftType=0, Rebuild=10, Refit=0.01})  # disabled
Z_2 = UnitZ(Factor=0.05)  # disabled
move = Move(Geometry=loft_2, Motion=Z_2)  # -> Geometry, Transform; disabled
swatch = ColourSwatch(SwatchColor=RGB(255, 255, 255))  # disabled
preview_4 = CustomPreview(Geometry=move.Geometry, Material=swatch)  # disabled
lng_2 = ListLength(List=selfos_v_0_env.street_network)
city_graph = CityGraph(
    Path=selfos_v_0_env.street_network,
    LengthCoefficient=1,
    AngularCoefficient=0,
    PairwiseShortestPaths=False,
    Radius=0,
    MaskInputString="100000011",
    PathInfoForPoints=False,
    UseGPU=True)  # -> BetweennessCentrality, ClosenessCentrality, Gravity, BetweennessCentralityWeighted, ClosenessCentralityWeighted, BetweennessCentralityNormalized, SupplementaryGeometry, PathsInformation, OutputGeometry
multiplication = Multiplication(A=lng_2, B=lng_2)
division = Division(A=city_graph.BetweennessCentrality, B=multiplication)
bnd = Bounds(Numbers=division)
remap = RemapNumbers(Value=division, Source=bnd, Target=Domain(0, 1))  # -> Mapped, Clipped
stats = Statistics(Series=remap.Mapped)  # -> SampleMean, Median, Average, StandardDeviation, Skewness, Kurtosis, Variance
panel_5 = Panel(stats.SampleMean)
panel_6 = Panel(stats.Median)
panel_7 = Panel(stats.StandardDeviation)
gradient = Gradient(
    LowerLimit=0,
    UpperLimit=1,
    Parameter=remap.Mapped,
    stops=[0: RGB(234, 38, 0), 0.25: RGB(234, 126, 0), 0.5: RGB(254, 244, 84), 0.75: RGB(173, 203, 249), 1: RGB(75, 107, 169)])
preview_5 = CustomPreview(Geometry=city_graph.OutputGeometry, Material=gradient)

# ----
# TERRAIN GENERATION
tuc_03 = Slider(16, range=0..100)
height_max_01 = Slider(64, range=0..1000)
height_max_03 = Slider(4, range=0..500)
height_max_04 = Slider(2, range=0..500)
terrain_unit_size = Slider(20, range=0..1000)
terrain_unit_count_tuc_01 = Slider(4, range=0..100)
tuc_02_terrain_complexity = Slider(8, range=0..100)
tuc_04 = Slider(32, range=0..100)
height_max_02 = Slider(16, range=0..500)

# ----
# EricksonLloydJones v-1
multiplication_2 = Multiplication(A=terrain_unit_size, B=terrain_unit_count_tuc_01)
area_2 = Area(Geometry=srf)  # -> Area, Centroid
Z_3 = UnitZ(Factor=1)
Z_4 = UnitZ(Factor=1)
city_graph_2 = CityGraph(
    Path=dupln,
    LengthCoefficient=1,
    AngularCoefficient=0,
    PairwiseShortestPaths=False,
    Radius=0,
    MaskInputString="100000011",
    PathInfoForPoints=False,
    UseGPU=False)  # -> BetweennessCentrality, ClosenessCentrality, Gravity, BetweennessCentralityWeighted, ClosenessCentralityWeighted, BetweennessCentralityNormalized, SupplementaryGeometry, PathsInformation, OutputGeometry
bnd_2 = Bounds(Numbers=city_graph_2.ClosenessCentrality)
remap_2 = RemapNumbers(Value=city_graph_2.ClosenessCentrality, Source=bnd_2, Target=Domain(0, 1))  # -> Mapped, Clipped
gradient_2 = Gradient(
    LowerLimit=0,
    UpperLimit=1,
    Parameter=remap_2.Mapped,
    stops=[0: RGB(234, 38, 0), 0.25: RGB(234, 126, 0), 0.5: RGB(254, 244, 84), 0.75: RGB(173, 203, 249), 1: RGB(75, 107, 169)])

start_pt = ConstructPoint(XCoordinate=expr("-x/2", multiplication_2), YCoordinate=expr("-x/2", multiplication_2), ZCoordinate=0)
terrain_generator = TerrainGenerator(
    start_point=start_pt,
    length=terrain_unit_size,
    width=terrain_unit_size,
    tuc_01=expr("x+1", terrain_unit_count_tuc_01),
    tuc_02=tuc_02_terrain_complexity,
    tuc_03=tuc_03,
    tuc_03_2=tuc_04,
    hmax01=height_max_01,
    hmax02=height_max_02,
    hmax03=height_max_03,
    hmax04=height_max_04,
    seed=Slider(1000, range=0..1000))  # -> base_srf, terrain_srf

# ---- group: Slope Mapping
# TERRAIN VISUALIZATION
resolution = Slider(200, range=0..1000)
mesh_uv = MeshSurface(Surface=terrain_generator.terrain_srf, UCount=resolution, VCount=resolution, Overhang=True, Equalize=True)
demesh = DeconstructMesh(Mesh=mesh_uv)  # -> Vertices, Faces, Colours, Normals
Z_5 = UnitZ(Factor=1)
angle = Angle(VectorA=demesh.Normals, VectorB=Z_5)  # -> Angle, Reflex
deg = Degrees(Radians=angle.Angle)
gradient_3 = Gradient(
    LowerLimit=0,
    UpperLimit=90,
    Parameter=deg,
    stops=[0: RGB(229, 229, 151), 0: RGB(230, 232, 209), 0.353: RGB(161, 203, 145), 0.498: RGB(105, 172, 143), 0.655: RGB(66, 139, 135), 0.801: RGB(51, 105, 117), 1: RGB(47, 72, 88)])
mcol = MeshColours(Mesh=mesh_uv, Colours=gradient_3)

# ---- group: Terrain/Base Srfs
srf_3 = Surface(terrain_generator.terrain_srf)
srf_4 = Surface(terrain_generator.base_srf)

# ---- group: Contours
Z_6 = UnitZ(Factor=1)
contour = Contour(Shape=terrain_generator.terrain_srf, Point=Point(0, 0, 0), Direction=Z_6, Distance=Slider(2, range=0..10))
preview_6 = CustomPreview(Geometry=contour, Material=ColourSwatch(SwatchColor=RGB(0, 0, 0)))

# ---- group: Terrain Srf Visual
bbox = BoundingBox(Content=terrain_generator.terrain_srf, Plane=PlaneXY(0, 0, 0), UnionBox=False)  # -> Box, Box_2
sint = SolidIntersection(BrepsA=bbox.Box, BrepsB=terrain_generator.terrain_srf)
Z_7 = UnitZ(Factor=-3)
move_2 = Move(Geometry=sint, Motion=Z_7)  # -> Geometry, Transform

# ----
split = SplitBrep(Brep=bbox.Box, Cutter=terrain_generator.terrain_srf)
project = ProjectPoint(Point=area_2.Centroid, Direction=Z_4, Geometry=srf_3)  # -> Point, Index
project_2 = Project(Curve=dupln, Brep=srf_3, Direction=Z_3)  # -> flatten(Curve)
project_3 = ProjectPoint(Point=area.Centroid, Direction=Z_3, Geometry=srf_3)  # -> Point, Index
item = ListItem(List=split, Index=-1, Wrap=True)
project_4 = Project(Geometry=srf, Plane=project.Point)  # -> Geometry, Transform
lng_3 = ListLength(List=project_4.Geometry)
random_2 = Random(Range=Domain(3, 6), Number=lng_3, Seed=Slider(63, range=0..100), Integers=True)
Z_8 = UnitZ(Factor=random_2)
extr_2 = Extrude(Base=project_4.Geometry, Direction=Z_8)
sunion_2 = SolidUnion(Breps=extr_2)
preview_7 = CustomPreview(Geometry=sunion_2, Material=ColourSwatch(SwatchColor=RGBA(253, 255, 255, 191)))
preview_8 = CustomPreview(Geometry=project_2, Material=gradient_2)

# ---- group: Terrain Srf Visual (continued)
preview_9 = CustomPreview(Geometry=item, Material=ColourSwatch(SwatchColor=RGBA(101, 83, 63, 220)))

# ----
enable = GhPythonScript(iter=hs.IterationsCounter)  # -> enabled
# ---------- enable: Python ----------
import scriptcontext as sc

enabled = True
if sc.sticky['enabled'] is not None:
    enabled = sc.sticky['enabled']
# ---------- end enable ----------
hs = HoopSnake(
    StartingData=Slider(0, range=0..1),
    TerminationCondition=enable,
    Hoopsnake_Data_autoUpdate=False,
    Hoopsnake_Data_dataLimit=2147483647,
    Hoopsnake_Data_resetCounter=True,
    Hoopsnake_Data_updateView=True)  # -> Feedback, CumulativeFeedback, LoopsCounter, IterationsCounter
environment_3 = GhPythonScript(iter=hs.IterationsCounter, render=render)  # -> out, grid_world, color_state, house_cells; inputs iter: Int32, render: Boolean
# ---------- environment_3: Python ----------
"""Implementation of an RL environment class based on 
the 'Beady Ring' model (Hillier & Hanson, 1984).
    Inputs:
        x: The x script variable
        y: The y script variable
    Output:
        a: The a output variable"""

import random
from math import floor
import socket
import struct
import pickle
import scriptcontext as sc
import ghpythonlib.components as ghcomp
import ghpythonlib.treehelpers as th


class Connection:
    def __init__(self, s):
        self._socket = s
        self._buffer = ""

    def receive_object(self):
        while len(self._buffer) < 4 or len(self._buffer) < struct.unpack("<L", self._buffer[:4])[0] + 4:
            new_bytes = self._socket.recv(16)
            if len(new_bytes) == 0:
                return None
            self._buffer += new_bytes
        length = struct.unpack("<L", self._buffer[:4])[0]
        header, body = self._buffer[:4], self._buffer[4:length + 4]
        obj = pickle.loads(body)
        self._buffer = self._buffer[length + 4:]
        return obj

    def send_object(self, d):
        body = pickle.dumps(d)
        header = struct.pack("<L", len(body))
        msg = header + body
        self._socket.send(msg)

class BeadyRing_env:
    def __init__(self):
        self._carrier_color = 127.5
        self._house_color = 0
        self._street_color = 255
        self._cell_size = 3
        self._max_row_len = 36
        self._obs_size = 37
        self._3d = False
        self.pad = int(floor(self._obs_size/2))
        self.max_world_row_len = int(self._max_row_len + 2*self.pad)
        self.iter = 0
        
        # grid world
        xy_plane = ghcomp.XYPlane(ghcomp.ConstructPoint(0, 0, 0))
        cell, _ = ghcomp.Rectangle(xy_plane, self._cell_size, self._cell_size, 0)
        
        r_max = self._cell_size * self.max_world_row_len
        move_range = [i for i in range(0, r_max, self._cell_size)]
        
        y_vec = ghcomp.UnitY(move_range)
        cell_col, _ = ghcomp.Move(cell, y_vec)
        
        x_vec = ghcomp.UnitX(move_range)
        grid_world = []
        for c in cell_col:
            cell_row, _ = ghcomp.Move(c, x_vec)
            grid_world.append(cell_row)
        
        self.grid_world = ghcomp.ReverseList(grid_world)
        
        # initial location
        self.R = int(floor(self.max_world_row_len/2))
        self.C = int(floor(self.max_world_row_len/2))
        
        R_space = [r for r in range(int(self.pad), int(self._max_row_len + self.pad))]
        C_space = [c for c in range(int(self.pad), int(self._max_row_len + self.pad))]
        self.RC_space = [[[r, c] for c in C_space] for r in R_space]
        
        self.x = self.R - self.pad
        self.y = self.C - self.pad
        
        self.cell = [[self.x, self.y], [self.R, self.C]]
        self.adjacent_cells = [[[self.x, self.y], [self.R, self.C]]]
        self.adj_cells = [[[self.x, self.y], [self.R, self.C]]]
        
        # initial state
        self.state = [[self._carrier_color for _ in range(int(self.max_world_row_len))] 
                        for _ in range(int(self.max_world_row_len))]
        
        # initial observation
        self.observation = self.get_obs()

    def step(self, _cell_state):
        self.iter += 1
        # update state step
        self.state[self.R][self.C] = 255*_cell_state
        
        for i, a in enumerate(self.adj_cells):
            if a == self.cell:
                del self.adj_cells[i]
        
        adjacent = self.get_adjacent()
        
        # reward
        reward = 0
        adj_street_count = 0
        
        for a in adjacent:
            if int(self.state[a[1][0]][a[1][1]]) == 255:
                adj_street_count += 1
        
        if _cell_state == 1:
            # density metric
            reward -= 1/(self._max_row_len**2)
            if adj_street_count >= 3:
                reward -= 1
            elif adj_street_count == 0:
                reward -= 1
        elif _cell_state == 0:
            if adj_street_count == 0:
                reward -= 1
            elif adj_street_count >= 3:
                reward -= 1
        
        for item in adjacent:
            if item not in self.adjacent_cells:
                self.adjacent_cells.append(item)
                self.adj_cells.append(item)
        
        # done
        done = False
        if len(self.adj_cells) == 0:
            done = True
        elif len(self.adj_cells) > 0:
            # next action location selection
            self.cell = random.choice(self.adj_cells)
            
            self.x = self.cell[0][0]
            self.y = self.cell[0][1]
            
            self.R = self.cell[1][0]
            self.C = self.cell[1][1]
        
        # observation
        self.observation = self.get_obs()
        
        return self.observation, reward, done, {}

    def reset(self):
        # initial state
        self.state = [[self._carrier_color for _ in range(int(self.max_world_row_len))] 
                        for _ in range(int(self.max_world_row_len))]
        
        # reset step counter
        self.iter = 0
        
        # initial location
        self.R = int(floor(self.max_world_row_len/2))
        self.C = int(floor(self.max_world_row_len/2))
        
        self.x = self.R - self.pad
        self.y = self.C - self.pad
        
        self.cell = [[self.x, self.y], [self.R, self.C]]
        self.adjacent_cells = [[[self.x, self.y], [self.R, self.C]]]
        self.adj_cells = [[[self.x, self.y], [self.R, self.C]]]
        
        # initial observation
        self.observation = self.get_obs()
        
        return self.observation

    def render(self):
        # state visualization
        color_state = [ghcomp.ColourRGB(255, self.state[i], self.state[i], 
                        self.state[i]) for i in range(self.max_world_row_len)]
        return color_state

    def get_obs(self):
        # observation
        left_up_R = int(self.R - self.pad)
        left_up_C = int(self.C - self.pad)
        right_bottom_R = int(self.R + self.pad)
        right_bottom_C = int(self.C + self.pad)
        obs_ = []
        for i in range(left_up_R, right_bottom_R + 1):
            obs_row = []
            for j in range(left_up_C, right_bottom_C + 1):
                item = self.state[i][j]
                obs_row.append(item)
            obs_.append(obs_row)
        return obs_

    def get_adjacent(self):
        # von Neumann neighbourhood
        adjacent = []
        if self.x < len(self.RC_space) - 1:
            adjacent.append([[self.x+1, self.y], self.RC_space[self.x+1][self.y]])
        if self.y > 0:
            adjacent.append([[self.x, self.y-1], self.RC_space[self.x][self.y-1]])
        if self.x > 0:
            adjacent.append([[self.x-1, self.y], self.RC_space[self.x-1][self.y]])
        if self.y < len(self.RC_space[self.x]) - 1:
            adjacent.append([[self.x, self.y+1], self.RC_space[self.x][self.y+1]])
        return adjacent

    def get_house_cells(self):
        ## house cells
        house_cells_ = []
        for i in range(self.max_world_row_len):
            for j in range(self.max_world_row_len):
                if self.state[i][j] == 0:
                    house_cells_.append(self.grid_world[i][j])
        return house_cells_


# Create environment instance
if 'env' not in globals():
    env = BeadyRing_env()

# establish connection with RL agent
if 'agent_conn' not in globals():
    addr = ("127.0.0.1", 50710)
    agent_socket = socket.socket(socket.AF_INET, socket.SOCK_STREAM)
    agent_socket.connect(addr)
    agent_conn = Connection(agent_socket)

# Connection
if iter == 0:
    # Reset
    msg_in = agent_conn.receive_object()
    if msg_in == "reset":
        state = env.reset()
        reward = None
        done = False
        info = {}
    else:
        raise RuntimeError("First message must be 'reset'")
else:
    # Send message
    msg_out = {"state": state,
            "reward": reward,
            "done": done,
            "info": info}
    agent_conn.send_object(msg_out)
    # Receive message
    msg_in = agent_conn.receive_object()
    if msg_in == "reset":
        state = env.reset()
        reward = None
        done = False
        info = {}
    elif msg_in == "close":
        env.reset()
        agent_socket.close()
        sc.sticky['enabled'] = False
    else:
        action = msg_in
        state, reward, done, info = env.step(action)
    
    if render:
        grid_world_ = th.list_to_tree(env.grid_world, source=[0,0])
        color_state = env.render()
        color_state_ = th.list_to_tree(color_state, source=[0,0])
        if env._3d:
            house_cells = env.get_house_cells()
            house_cells_ = th.list_to_tree(house_cells, source=[0,0])
# ---------- end environment_3 ----------
cluster = Cluster(srf=environment_3.grid_world, M=environment_3.color_state, srf_2=environment_3.house_cells)

# ==== cluster Cluster
srf = ClusterInput()
M = ClusterInput()
srf_2 = ClusterInput()
srf_3 = Surface(srf)
srf_4 = Surface(srf_2)
preview = CustomPreview(Geometry=srf_3, Material=M)
lng = ListLength(List=srf_4)
random = Random(Range=Domain(4, 6), Number=lng, Seed=Slider(76, range=0..100), Integers=True)
Z = UnitZ(Factor=random)
extr = Extrude(Base=srf_4, Direction=Z)
preview_2 = CustomPreview(Geometry=extr, Material=ColourSwatch(SwatchColor=RGB(0, 0, 0)))

# ==== cluster TerrainGenerator
start_point = ClusterInput()
length = ClusterInput()
width = ClusterInput()
tuc_01 = ClusterInput()
tuc_02 = ClusterInput()
tuc_03 = ClusterInput()
tuc_03_2 = ClusterInput()
hmax01 = ClusterInput()
hmax02 = ClusterInput()
hmax03 = ClusterInput()
hmax04 = ClusterInput()
seed = ClusterInput()
rectangle = Rectangle(Plane=PlaneXY(0, 0, 0), XSize=length, YSize=width, Radius=0)  # -> Rectangle, Length
arrrec = RectangularArray(Geometry=start_point, Cell=rectangle.Rectangle, XCount=tuc_01, YCount=tuc_01)  # -> Geometry, Transform
lng = ListLength(List=arrrec.Geometry)
random = Random(Range=hmax01, Number=lng, Seed=seed)
Z = UnitZ(Factor=random)
move = Move(Geometry=arrrec.Geometry, Motion=Z)  # -> Geometry, Transform
srfgrid = SurfaceFromPoints(Points=move.Geometry, UCount=tuc_01, Interpolate=False)
toporandomnoise = TopoRandomNoise(C=srfgrid, N=tuc_02, R=hmax02, S=seed)
toporandomnoise_2 = TopoRandomNoise(C=toporandomnoise, N=tuc_03, R=hmax03, S=seed)
toporandomnoise_3 = TopoRandomNoise(C=toporandomnoise_2, N=tuc_03_2, R=hmax04, S=seed)
srfgrid_2 = SurfaceFromPoints(Points=arrrec.Geometry, UCount=tuc_01, Interpolate=False)
terrain_srf = ClusterOutput(toporandomnoise_3)
base_srf = ClusterOutput(srfgrid_2)

# ==== cluster TopoRandomNoise
C = ClusterInput()
N = ClusterInput()
R = ClusterInput()
S = ClusterInput()
bbox = BoundingBox(Content=C, Plane=PlaneXY(0, 0, 0))  # -> Box, Box_2
debox = DeconstructBox(Box=bbox.Box)  # -> Plane, X, Y, Z
range = Range(Domain=debox.X, Steps=N)
range_2 = Range(Domain=debox.Y, Steps=N)
pt = ConstructPoint(XCoordinate=graft(range), YCoordinate=range_2, ZCoordinate=0)
Z = UnitZ(Factor=1)
project = ProjectPoint(Point=pt, Direction=Z, Geometry=C)  # -> flatten(Point), Index
lng = ListLength(List=project.Point)
random = Random(Range=R, Number=lng, Seed=S)
Z_2 = UnitZ(Factor=random)
move = Move(Geometry=project.Point, Motion=Z_2)  # -> Geometry, Transform
srfgrid = SurfaceFromPoints(Points=move.Geometry, UCount=expr("x+1", N), Interpolate=False)
S_2 = ClusterOutput(srfgrid)
