# Grasshopper definition ELJenv_V0.gh (Grasshopper 1.0.7)
# plug-ins: HoopSnake, DeCodingSpaces

number_slider = Slider(0, range=0..1)  # disabled
starting_data = Slider(0, range=0..1)

# ---- group: RH_IN:action
int = Integer()  # disabled

# ---- group: RH_IN:reset
bool = Boolean()  # disabled

# ----
maxradius = Slider(38, range=0..1000)
cellsize = Slider(3, range=0..10)
environment = GhPythonScript(action=int, reset=bool)  # -> out, simplify(grid_world), simplify(color_state), observation, reward, done, info; inputs action: Int32, reset: Boolean; disabled
# ---------- environment: Python ----------
"""Implementation of an RL environment class based on 
the 'Beady Ring' model (Hillier & Hanson, 1984).
    Inputs:
        x: The x script variable
        y: The y script variable
    Output:
        a: The a output variable"""

import random
from math import floor
import scriptcontext as sc
import ghpythonlib.components as ghcomp
import ghpythonlib.treehelpers as th


class BeadyRing_env:
    def __init__(self):
        self._carrier_color = 127.5
        self._house_color = 0
        self._street_color = 255
        self._cell_size = 3
        self._max_row_len = 36
        self._obs_size = 3
        self.pad = int(floor(self._obs_size/2))
        self.max_world_row_len = int(self._max_row_len + 2*self.pad)
        self.iter = 0
        
        # grid world
        xy_plane = ghcomp.XYPlane(ghcomp.ConstructPoint(0, 0, 0))
        cell, _ = ghcomp.Rectangle(xy_plane, self._cell_size, self._cell_size, 0)
        
        r_max = self._cell_size * self.max_world_row_len
        move_range = [i for i in range(0, r_max, self._cell_size)]
        
        y_vec = ghcomp.UnitY(move_range)
        cell_col, _ = ghcomp.Move(cell, y_vec)
        
        x_vec = ghcomp.UnitX(move_range)
        grid_world = []
        for c in cell_col:
            cell_row, _ = ghcomp.Move(c, x_vec)
            grid_world.append(cell_row)
        
        self.grid_world = ghcomp.ReverseList(grid_world)
        
        # initial location
        self.R = int(floor(self.max_world_row_len/2))
        self.C = int(floor(self.max_world_row_len/2))
        
        self.x = self.R - self.pad
        self.y = self.C - self.pad
        
        self.cell = [self.x, self.y]
        self.adjacent_cells = [[self.x, self.y]]
        self.adj_cells = [[self.x, self.y]]
        
        # initial state
        self.state = [[self._carrier_color for _ in range(int(self.max_world_row_len))] 
                        for _ in range(int(self.max_world_row_len))]
        
        # initial observation
        self.observation = self.get_obs()

    def step(self, _cell_state):
        self.iter += 1
        # update state step
        self.state[self.R][self.C] = 255*_cell_state
        
        for i, a in enumerate(self.adj_cells):
            if a == self.cell:
                del self.adj_cells[i]
        
        adjacent = self.get_adjacent()
        
        # reward
        reward = 0
        adj_street_count = 0
        
        for a in adjacent:
            if int(self.state[a[0] + self.pad][a[1] + self.pad]) == 255:
                adj_street_count += 1
        
        if _cell_state == 1:
            # density metric
            reward -= 1/(self._max_row_len**2)
            if adj_street_count >= 3:
                reward -= 1
            elif adj_street_count == 0:
                reward -= 1
        elif _cell_state == 0:
            if adj_street_count == 0:
                reward -= 1
            elif adj_street_count >= 3:
                reward -= 1
        
        for item in adjacent:
            if item not in self.adjacent_cells:
                self.adjacent_cells.append(item)
                self.adj_cells.append(item)
        
        # done
        done = False
        if len(self.adj_cells) == 0:
            done = True
        elif len(self.adj_cells) > 0:
            # next action location selection
            self.cell = random.choice(self.adj_cells)
            
            self.x = self.cell[0]
            self.y = self.cell[1]
            
            self.R = self.x + self.pad
            self.C = self.y + self.pad
        
        # observation
        self.observation = self.get_obs()
        
        return self.observation, reward, done, {}

    def reset(self):
        # initial state
        self.state = [[self._carrier_color for _ in range(int(self.max_world_row_len))] 
                        for _ in range(int(self.max_world_row_len))]
        
        # reset step counter
        self.iter = 0
        
        # initial location
        self.R = int(floor(self.max_world_row_len/2))
        self.C = int(floor(self.max_world_row_len/2))
        
        self.x = self.R - self.pad
        self.y = self.C - self.pad
        
        self.cell = [self.x, self.y]
        self.adjacent_cells = [[self.x, self.y]]
        self.adj_cells = [[self.x, self.y]]
        
        # initial observation
        self.observation = self.get_obs()
        
        return self.observation

    def render(self):
        # state visualization
        color_state = [ghcomp.ColourRGB(255, self.state[i], self.state[i], 
                        self.state[i]) for i in range(self.max_world_row_len)]
        return color_state

    def get_obs(self):
        # observation
        left_up_R = int(self.R - self.pad)
        left_up_C = int(self.C - self.pad)
        right_bottom_R = int(self.R + self.pad)
        right_bottom_C = int(self.C + self.pad)
        obs_ = []
        for i in range(left_up_R, right_bottom_R + 1):
            obs_row = []
            for j in range(left_up_C, right_bottom_C + 1):
                item = self.state[i][j]
                obs_row.append(item)
            obs_.append(obs_row)
        return obs_

    def get_adjacent(self):
        # von Neumann neighbourhood
        adjacent = []
        if self.x < self._max_row_len - 1:
            adjacent.append([self.x+1, self.y])
        if self.y > 0:
            adjacent.append([self.x, self.y-1])
        if self.x > 0:
            adjacent.append([self.x-1, self.y])
        if self.y < self._max_row_len - 1:
            adjacent.append([self.x, self.y+1])
        return adjacent

if 'env' not in globals():
    env = BeadyRing_env()
    sc.sticky['env'] = env

if reset:
    observation = sc.sticky['env'].reset()
    observation = th.list_to_tree(observation, source=[0,0])
    reward = None
    done = False
    info = {}
    grid_world_ = th.list_to_tree(sc.sticky['env'].grid_world, source=[0,0])
    color_state = sc.sticky['env'].render()
    color_state_ = th.list_to_tree(color_state, source=[0,0])
    
elif action is not None:
    observation, reward, done, info = sc.sticky['env'].step(action)
    observation = th.list_to_tree(observation, source=[0,0])
    reward = th.list_to_tree(reward, source=[0,0])
    done = th.list_to_tree(done, source=[0,0])
    info = th.list_to_tree(info, source=[0,0])
    grid_world_ = th.list_to_tree(sc.sticky['env'].grid_world, source=[0,0])
    color_state = sc.sticky['env'].render()
    color_state_ = th.list_to_tree(color_state, source=[0,0])
    
else:
    raise RuntimeError("Either reset or action must be provided")
# ---------- end environment ----------
render = BooleanToggle(False)  # disabled

# ---- group: RH_OUT:geo
geo = Geometry(environment.grid_world)  # disabled

# ---- group: RH_OUT:color
num = Number(environment.color_state)  # disabled

# ---- group: RH_OUT:observation
geo_2 = Geometry(environment.observation)  # disabled

# ---- group: RH_OUT:reward
num_2 = Number(environment.reward)  # disabled

# ---- group: RH_OUT:done
bool_2 = Boolean(environment.done)  # disabled

# ---- group: RH_OUT:info
txt = Text(environment.info)  # disabled

# ----
enable = GhPythonScript(iter=hs.IterationsCounter)  # -> enabled; disabled
# ---------- enable: Python ----------
import scriptcontext as sc

enabled = True
if sc.sticky['enabled'] is not None:
    enabled = sc.sticky['enabled']
# ---------- end enable ----------
hs = HoopSnake(
    StartingData=number_slider,
    TerminationCondition=enable,
    Hoopsnake_Data_autoUpdate=False,
    Hoopsnake_Data_dataLimit=2147483647,
    Hoopsnake_Data_resetCounter=True,
    Hoopsnake_Data_updateView=True)  # -> Feedback, CumulativeFeedback, LoopsCounter, IterationsCounter; disabled
environment_2 = GhPythonScript(iter=hs.IterationsCounter, render=render)  # -> out, grid_world, color_state, house_cells; inputs iter: Int32, render: Boolean; disabled
# ---------- environment_2: Python ----------
"""Implementation of an RL environment class based on 
the 'Beady Ring' model (Hillier & Hanson, 1984).
    Inputs:
        x: The x script variable
        y: The y script variable
    Output:
        a: The a output variable"""

import random
from math import floor
import socket
import struct
import pickle
import scriptcontext as sc
import ghpythonlib.components as ghcomp
import ghpythonlib.treehelpers as th


class Connection:
    def __init__(self, s):
        self._socket = s
        self._buffer = ""

    def receive_object(self):
        while len(self._buffer) < 4 or len(self._buffer) < struct.unpack("<L", self._buffer[:4])[0] + 4:
            new_bytes = self._socket.recv(16)
            if len(new_bytes) == 0:
                return None
            self._buffer += new_bytes
        length = struct.unpack("<L", self._buffer[:4])[0]
        header, body = self._buffer[:4], self._buffer[4:length + 4]
        obj = pickle.loads(body)
        self._buffer = self._buffer[length + 4:]
        return obj

    def send_object(self, d):
        body = pickle.dumps(d)
        header = struct.pack("<L", len(body))
        msg = header + body
        self._socket.send(msg)

class BeadyRing_env:
    def __init__(self):
        self._carrier_color = 127.5
        self._house_color = 0
        self._street_color = 255
        self._cell_size = 3
        self._max_row_len = 36
        self._obs_size = 37
        self._3d = False
        self.pad = int(floor(self._obs_size/2))
        self.max_world_row_len = int(self._max_row_len + 2*self.pad)
        self.iter = 0
        
        # grid world
        xy_plane = ghcomp.XYPlane(ghcomp.ConstructPoint(0, 0, 0))
        cell, _ = ghcomp.Rectangle(xy_plane, self._cell_size, self._cell_size, 0)
        
        r_max = self._cell_size * self.max_world_row_len
        move_range = [i for i in range(0, r_max, self._cell_size)]
        
        y_vec = ghcomp.UnitY(move_range)
        cell_col, _ = ghcomp.Move(cell, y_vec)
        
        x_vec = ghcomp.UnitX(move_range)
        grid_world = []
        for c in cell_col:
            cell_row, _ = ghcomp.Move(c, x_vec)
            grid_world.append(cell_row)
        
        self.grid_world = ghcomp.ReverseList(grid_world)
        
        # initial location
        self.R = int(floor(self.max_world_row_len/2))
        self.C = int(floor(self.max_world_row_len/2))
        
        R_space = [r for r in range(int(self.pad), int(self._max_row_len + self.pad))]
        C_space = [c for c in range(int(self.pad), int(self._max_row_len + self.pad))]
        self.RC_space = [[[r, c] for c in C_space] for r in R_space]
        
        self.x = self.R - self.pad
        self.y = self.C - self.pad
        
        self.cell = [[self.x, self.y], [self.R, self.C]]
        self.adjacent_cells = [[[self.x, self.y], [self.R, self.C]]]
        self.adj_cells = [[[self.x, self.y], [self.R, self.C]]]
        
        # initial state
        self.state = [[self._carrier_color for _ in range(int(self.max_world_row_len))] 
                        for _ in range(int(self.max_world_row_len))]
        
        # initial observation
        self.observation = self.get_obs()

    def step(self, _cell_state):
        self.iter += 1
        # update state step
        self.state[self.R][self.C] = 255*_cell_state
        
        for i, a in enumerate(self.adj_cells):
            if a == self.cell:
                del self.adj_cells[i]
        
        adjacent = self.get_adjacent()
        
        # reward
        reward = 0
        adj_street_count = 0
        
        for a in adjacent:
            if int(self.state[a[1][0]][a[1][1]]) == 255:
                adj_street_count += 1
        
        if _cell_state == 1:
            # density metric
            reward -= 1/(self._max_row_len**2)
            if adj_street_count >= 3:
                reward -= 1
            elif adj_street_count == 0:
                reward -= 1
        elif _cell_state == 0:
            if adj_street_count == 0:
                reward -= 1
            elif adj_street_count >= 3:
                reward -= 1
        
        for item in adjacent:
            if item not in self.adjacent_cells:
                self.adjacent_cells.append(item)
                self.adj_cells.append(item)
        
        # done
        done = False
        if len(self.adj_cells) == 0:
            done = True
        elif len(self.adj_cells) > 0:
            # next action location selection
            self.cell = random.choice(self.adj_cells)
            
            self.x = self.cell[0][0]
            self.y = self.cell[0][1]
            
            self.R = self.cell[1][0]
            self.C = self.cell[1][1]
        
        # observation
        self.observation = self.get_obs()
        
        return self.observation, reward, done, {}

    def reset(self):
        # initial state
        self.state = [[self._carrier_color for _ in range(int(self.max_world_row_len))] 
                        for _ in range(int(self.max_world_row_len))]
        
        # reset step counter
        self.iter = 0
        
        # initial location
        self.R = int(floor(self.max_world_row_len/2))
        self.C = int(floor(self.max_world_row_len/2))
        
        self.x = self.R - self.pad
        self.y = self.C - self.pad
        
        self.cell = [[self.x, self.y], [self.R, self.C]]
        self.adjacent_cells = [[[self.x, self.y], [self.R, self.C]]]
        self.adj_cells = [[[self.x, self.y], [self.R, self.C]]]
        
        # initial observation
        self.observation = self.get_obs()
        
        return self.observation

    def render(self):
        # state visualization
        color_state = [ghcomp.ColourRGB(255, self.state[i], self.state[i], 
                        self.state[i]) for i in range(self.max_world_row_len)]
        return color_state

    def get_obs(self):
        # observation
        left_up_R = int(self.R - self.pad)
        left_up_C = int(self.C - self.pad)
        right_bottom_R = int(self.R + self.pad)
        right_bottom_C = int(self.C + self.pad)
        obs_ = []
        for i in range(left_up_R, right_bottom_R + 1):
            obs_row = []
            for j in range(left_up_C, right_bottom_C + 1):
                item = self.state[i][j]
                obs_row.append(item)
            obs_.append(obs_row)
        return obs_

    def get_adjacent(self):
        # von Neumann neighbourhood
        adjacent = []
        if self.x < len(self.RC_space) - 1:
            adjacent.append([[self.x+1, self.y], self.RC_space[self.x+1][self.y]])
        if self.y > 0:
            adjacent.append([[self.x, self.y-1], self.RC_space[self.x][self.y-1]])
        if self.x > 0:
            adjacent.append([[self.x-1, self.y], self.RC_space[self.x-1][self.y]])
        if self.y < len(self.RC_space[self.x]) - 1:
            adjacent.append([[self.x, self.y+1], self.RC_space[self.x][self.y+1]])
        return adjacent

    def get_house_cells(self):
        ## house cells
        house_cells_ = []
        for i in range(self.max_world_row_len):
            for j in range(self.max_world_row_len):
                if self.state[i][j] == 0:
                    house_cells_.append(self.grid_world[i][j])
        return house_cells_


# Create environment instance
if 'env' not in globals():
    env = BeadyRing_env()

# establish connection with RL agent
if 'agent_conn' not in globals():
    addr = ("127.0.0.1", 50710)
    agent_socket = socket.socket(socket.AF_INET, socket.SOCK_STREAM)
    agent_socket.connect(addr)
    agent_conn = Connection(agent_socket)

# Connection
if iter == 0:
    # Reset
    msg_in = agent_conn.receive_object()
    if msg_in == "reset":
        state = env.reset()
        reward = None
        done = False
        info = {}
    else:
        raise RuntimeError("First message must be 'reset'")
else:
    # Send message
    msg_out = {"state": state,
            "reward": reward,
            "done": done,
            "info": info}
    agent_conn.send_object(msg_out)
    # Receive message
    msg_in = agent_conn.receive_object()
    if msg_in == "reset":
        state = env.reset()
        reward = None
        done = False
        info = {}
    elif msg_in == "close":
        env.reset()
        agent_socket.close()
        sc.sticky['enabled'] = False
    else:
        action = msg_in
        state, reward, done, info = env.step(action)
    
    if render:
        grid_world_ = th.list_to_tree(env.grid_world, source=[0,0])
        color_state = env.render()
        color_state_ = th.list_to_tree(color_state, source=[0,0])
        if env._3d:
            house_cells = env.get_house_cells()
            house_cells_ = th.list_to_tree(house_cells, source=[0,0])
# ---------- end environment_2 ----------
cluster = Cluster(srf=environment_2.grid_world, M=environment_2.color_state, srf_2=environment_2.house_cells)  # disabled
enable_2 = GhPythonScript(iter=hs_2.IterationsCounter)  # -> enabled; same code as enable
hs_2 = HoopSnake(
    StartingData=starting_data,
    TerminationCondition=enable_2,
    Hoopsnake_Data_autoUpdate=False,
    Hoopsnake_Data_dataLimit=2147483647,
    Hoopsnake_Data_resetCounter=True,
    Hoopsnake_Data_updateView=True)  # -> Feedback, CumulativeFeedback, LoopsCounter, IterationsCounter
eljenv_v0 = GhPythonScript(iter=hs_2.IterationsCounter, cellSize=cellsize, maxRadius=maxradius)  # -> out, action, render, house_cells; inputs iter: Int32
# ---------- eljenv_v0: Python ----------
import random
import socket
import struct
import pickle
import scriptcontext as sc
import ghpythonlib.components as ghcomp
import ghpythonlib.treehelpers as th


class EricksonLJ_env:
    def __init__(self, cellSize, maxRadius):
        self._cell_size = cellSize
        self.maxRadius = maxRadius
        self.neighborCount = 20
        self.iter = 0
        
        # initial location
        self.x = 0
        self.y = 0
        self.initPt = ghcomp.ConstructPoint(self.x, self.y, 0)
        
        self.pos = [self.x, self.y]
        self.adjacent_locs = [[self.x, self.y]]
        self.adj_locs = [[self.x, self.y]]
        self.rotationSpace = [-30 + 5*n for n in range(13)]
        
        # initial state
        self.cells = []
        self.network = []
        self.BC = 0
        self.CC = 0
        self.streets = []
        self.nodes = []
        self.houses = []
        self.cell = None
        self.currentPt = ghcomp.ConstructPoint(self.x, self.y, 0)
        self.posPts = []
        self.posPts.append(self.currentPt)
        self.visitedPts = []
        self.cellTypes = []
        
        self.observation = self.get_obs()
        self.reward = 0
        self.done = False
        self.info = {}
    
    def step(self, action):
        self.iter += 1
        # update state step
        self.cell = self.make_cell(action[1])
        self.cells.append(self.cell)
        self.visitedPts.append(self.currentPt)
        if action[0] == 1:
            self.streets.append(self.cell)
            self.nodes.append(self.currentPt)
            self.cellTypes.append(1)
        elif action[0] == 0:
            self.houses.append(self.cell)
            self.cellTypes.append(0)
        else:
            raise ValueError("action value {} is not valid".format(action[0]))
        
        try:
            del self.adj_locs[0]
        except:
            raise RuntimeError("The current action cell must be deleted at each step.")
        
        # deleted = 0
        # for i, a in enumerate(self.adj_locs):
            # if abs(a[0]-self.x)<0.1 and abs(a[1]-self.y)<0.1:
                # del self.adj_locs[i]
                # deleted += 1
        # if deleted == 0:
            # raise RuntimeError("The current action cell must be deleted at each step.")
        
        adjacent, adjacentPts = self.get_adjacent()
        
        # update street network
        if action[0] == 1 and len(self.streets) > 1:
            self.update_street_network() 
        
        if action[0] == 1: # Add adjacent cells only if it's a street cell
            handled = 0
            for i, pt in enumerate(adjacentPts):
                handled += 1
                _is_close = False
                distances = ghcomp.Distance(pt, self.posPts)
                if isinstance(distances, list):
                    for distance in distances:
                        if distance < 0.8*self._cell_size:
                            _is_close = True
                            break
                if not _is_close:
                    self.adjacent_locs.append(adjacent[i])
                    self.adj_locs.append(adjacent[i])
                    self.posPts.append(pt) # keep track of all the visited points
            assert handled == len(adjacent), "Only {} adjacent point(s) was/were handled, should be {}".format(handled, len(adjacent))
        
        # done
        self.done = len(self.adj_locs) == 0
        if ghcomp.Distance(self.initPt, self.currentPt) > self.maxRadius:
            self.done = True
        
        if len(self.adj_locs) > 0:
            # next action location selection
            self.pos = self.adj_locs[0] # random.choice(self.adj_locs)
            self.x = self.pos[0]
            self.y = self.pos[1]
            self.currentPt = ghcomp.ConstructPoint(self.x, self.y, 0)
        
        # observation
        self.observation = self.get_obs()
    
    def reset(self):
        # reset step counter
        self.iter = 0
        
        # initial location
        self.x = 0
        self.y = 0
        
        self.pos = [self.x, self.y]
        self.adjacent_locs = [[self.x, self.y]]
        self.adj_locs = [[self.x, self.y]]
        
        # initial state
        self.cells = []
        self.network = []
        self.BC = 0
        self.CC = 0
        self.streets = []
        self.nodes = []
        self.houses = []
        self.cell = None
        self.currentPt = ghcomp.ConstructPoint(self.x, self.y, 0)
        self.posPts = []
        self.posPts.append(self.currentPt)
        self.visitedPts = []
        self.cellTypes = []
        
        self.observation = self.get_obs()
        self.reward = 0
        self.done = False
        self.info = {}
    
    def get_obs(self):
        # init_obs
        neighborStates = [0]*self.neighborCount
        coordX = [0]*self.neighborCount
        coordY = [0]*self.neighborCount
        if len(self.visitedPts) > 0:
            closestPts, indices, _= ghcomp.ClosestPoints(self.currentPt, self.visitedPts, self.neighborCount)
            for i, pt in enumerate(closestPts):
                x, y, _ = ghcomp.Deconstruct(pt)
                coordX[i] = x/self.maxRadius
                coordY[i] = y/self.maxRadius
                neighborStates[i] = self.cellTypes[indices[i]]
        obs = neighborStates + coordX + coordY
        return obs
    
    def get_adjacent(self): 
        # von Neumann neighbourhood
        _, center = ghcomp.Area(self.cell)
        _, edges, _ = ghcomp.DeconstructBrep(self.cell)
        midPts = ghcomp.CurveMiddle(edges)
        vecs, _ = ghcomp.Vector2Pt(center, midPts, True)
        lines = ghcomp.LineSDL(center, vecs, self._cell_size)
        _, endPts = ghcomp.EndPoints(lines)
        adjacent = []
        for pt in endPts:
            x, y, _ = ghcomp.Deconstruct(pt)
            adjacent.append([x, y])
        return adjacent, endPts
    
    def make_cell(self, angle):
        angle = self.rotationSpace[angle]
        half = self._cell_size/2
        domain = ghcomp.ConstructDomain(-half, half)
        center = ghcomp.ConstructPoint(self.x, self.y, 0)
        cell, _ = ghcomp.Rectangle(center, domain, domain, 0)
        cell, _ = ghcomp.Rotate(cell, ghcomp.Radians(angle), center)
        return cell
    
    def update_street_network(self):
        circle = ghcomp.Circle(self.currentPt, self._cell_size)
        relationship, _ = ghcomp.PointInCurve(self.nodes[:-1], circle)
        pattern = []
        if isinstance(relationship, list):
            pattern = [r != 0 for r in relationship]
        elif isinstance(relationship, int):
            pattern = relationship != 0
        connectedPts = ghcomp.CullPattern(self.nodes[:-1], pattern)
        edges = ghcomp.Line(self.currentPt, connectedPts)
        if isinstance(edges, list):
            for edge in edges:
                self.network.append(edge)
        else:
            if edges is not None:
                self.network.append(edges) 
        if len(self.network) > 1:
            clean_net = ghcomp.Kangaroo2Component.removeDuplicateLines(self.network, 0.01)
            self.network = [item for item in clean_net]

class Connection:
    def __init__(self, s):
        self._socket = s
        self._buffer = ""

    def receive_object(self):
        while len(self._buffer) < 4 or len(self._buffer) < struct.unpack("<L", self._buffer[:4])[0] + 4:
            new_bytes = self._socket.recv(16)
            if len(new_bytes) == 0:
                return None
            self._buffer += new_bytes
        length = struct.unpack("<L", self._buffer[:4])[0]
        header, body = self._buffer[:4], self._buffer[4:length + 4]
        obj = pickle.loads(body)
        self._buffer = self._buffer[length + 4:]
        return obj

    def send_object(self, d):
        body = pickle.dumps(d)
        header = struct.pack("<L", len(body))
        msg = header + body
        self._socket.send(msg)

# Create environment instance
if 'env' not in globals():
    env = EricksonLJ_env(cellSize, maxRadius)
    env.reset()
    sc.sticky['env'] = env

# establish connection with RL agent
if 'agent_conn' not in globals():
    addr = ("127.0.0.1", 50710)
    agent_socket = socket.socket(socket.AF_INET, socket.SOCK_STREAM)
    sc.sticky['agent_socket'] = agent_socket
    sc.sticky['agent_socket'].connect(addr)
    agent_conn = Connection(sc.sticky['agent_socket'])
    sc.sticky['agent_conn'] = agent_conn

render = False 
if iter == 0:
    # Reset
    msg_in = sc.sticky['agent_conn'].receive_object()
    if msg_in == "reset":
        sc.sticky['env'].reset()
    else:
        raise RuntimeError("First message must be 'reset'")
else:
    # Receive message
    msg_in = sc.sticky['agent_conn'].receive_object()
    if msg_in == "reset":
        sc.sticky['env'].reset()
    elif msg_in == "close":
        sc.sticky['env'].reset()
        sc.sticky['agent_socket'].close()
        sc.sticky['enabled'] = False
    elif msg_in == "render":
        render = True
        house_cells_ = th.list_to_tree(sc.sticky['env'].houses, source=[0,0])
    else:
        action = msg_in
        sc.sticky['env'].step(action)
# ---------- end eljenv_v0 ----------
panel = Panel(eljenv_v0.out)
python = GhPythonScript(action=eljenv_v0.action)  # -> out, network; inputs action: list
# ---------- python: Python ----------
import scriptcontext as sc
import ghpythonlib.treehelpers as th


# reward
sc.sticky['env'].reward = 0

if len(action) > 0:
    if action[0] == 0: # reward if house cell
        sc.sticky['env'].reward += 1 # density

network = sc.sticky['env'].network
network = th.list_to_tree(network, source=[0,0])
# ---------- end python ----------
city_graph = CityGraph(
    Path=python.network,
    LengthCoefficient=1,
    AngularCoefficient=0,
    PairwiseShortestPaths=False,
    Radius=0,
    MaskInputString="000000011",
    PathInfoForPoints=False,
    UseGPU=True)  # -> BetweennessCentrality, ClosenessCentrality, Gravity, BetweennessCentralityWeighted, ClosenessCentralityWeighted, BetweennessCentralityNormalized, SupplementaryGeometry, PathsInformation, OutputGeometry
python_2 = GhPythonScript(BC=city_graph.BetweennessCentrality, CC=city_graph.ClosenessCentrality)  # -> out, reward; inputs BC: list, CC: list
# ---------- python_2: Python ----------
import scriptcontext as sc
from statistics import mean
from math import isinf


# reward
if len(BC) > 0:
    if not isinf(BC[0]):
        currentBC = mean(BC)
        deltaBC = currentBC - sc.sticky['env'].BC
        sc.sticky['env'].reward += deltaBC 
        # update current network BC
        sc.sticky['env'].BC = currentBC

if len(CC) > 0:
    if not isinf(CC[0]):
        currentCC = mean(CC)
        deltaCC = currentCC - sc.sticky['env'].CC
        sc.sticky['env'].reward += deltaCC 
        # update current network CC
        sc.sticky['env'].CC = currentCC

reward = sc.sticky['env'].reward
# ---------- end python_2 ----------
visualunit = VisualUnit(srf=eljenv_v0.house_cells, R=maxradius, L=python.network, A=city_graph.BetweennessCentrality)
rl_agent = GhPythonScript(reward=python_2.reward, render=eljenv_v0.render)  # -> out
# ---------- rl_agent: Python ----------
import socket
import struct
import pickle
import scriptcontext as sc
import ghpythonlib.components as ghcomp
import ghpythonlib.treehelpers as th


visPerspective = None
visTop = None
if render:
    try:
        import System
    except ImportError as e:  
        raise ImportError("Failed to import System.\n{}".format(e))
    
    try:
        from ladybug_rhino.viewport import viewport_by_name
    except ImportError as e:
        raise ImportError('\nFailed to import ladybug_rhino:\n\t{}'.format(e))
    
    try:
        import Rhino.Display as rd
    except ImportError as e:  # No RhinoCommon doc is available. This module is useless.
        raise ImportError("Failed to import Rhino.\n{}".format(e))
    
    def capture_view(file_path, viewport, width=None, height=None, display_mode=None):
        """Capture a Viewport to a PNG file path.
        Returns:
            Bitmap values of the image.
        """
        # create the view capture object
        img_w = viewport.Size.Width if width is None else width
        img_h = viewport.Size.Height if height is None else height
        img_size = System.Drawing.Size(img_w, img_h)
    
        # capture the view
        if display_mode is not None:
            mode_obj = rd.DisplayModeDescription.FindByName(display_mode)
            pic = viewport.ParentView.CaptureToBitmap(img_size, mode_obj)
        else:
            pic = viewport.ParentView.CaptureToBitmap(img_size)
    
        # save the bitmap to a png file
        if not file_path.endswith('.png'):
            file_path = '{}.png'.format(file_path)
        System.Drawing.Bitmap.Save(pic, file_path)
    
        return file_path
     
    mode_ = 'Rendered'
    width_ = 1080
    height_ = 1080
    
    # get the viewport objects
    vp_names = ['Perspective', 'Top']
    viewports = [viewport_by_name(vp) for vp in vp_names]
    
    fpPerspective = 'D:/RLinGUD/EricksonLloyd-Jones/EJLperspective_train/iter{}_rwd_{}.png'.format(sc.sticky['env'].iter, reward)
    fpTop = 'D:/RLinGUD/EricksonLloyd-Jones/EJLtop_train/iter{}_rwd_{}.png'.format(sc.sticky['env'].iter, reward)
    
    # save the viewports to images
    visPerspective = capture_view(fpPerspective, viewports[0], width_, height_, mode_)
    visTop = capture_view(fpTop, viewports[1], width_, height_, mode_)
    
# Send message
msg_out = {"state": sc.sticky['env'].observation,
        "reward": reward,
        "done": sc.sticky['env'].done,
        "info": sc.sticky['env'].info,
        "visPerspective": visPerspective,
        "visTop": visTop
        }
sc.sticky['agent_conn'].send_object(msg_out)
# ---------- end rl_agent ----------
panel_2 = Panel(rl_agent)

# ==== cluster VisualUnit
srf = ClusterInput()
R = ClusterInput()
L = ClusterInput()
A = ClusterInput()

# ---- group: network analysis Viz
lng = ListLength(List=L)
multiplication = Multiplication(A=lng, B=lng)
division = Division(A=A, B=multiplication)
bnd = Bounds(Numbers=division)
remap = RemapNumbers(Value=division, Source=bnd, Target=Domain(0, 1))  # -> Mapped, Clipped
gradient = Gradient(
    LowerLimit=0,
    UpperLimit=1,
    Parameter=remap.Mapped,
    stops=[0: RGB(234, 38, 0), 0.25: RGB(234, 126, 0), 0.5: RGB(254, 244, 84), 0.75: RGB(173, 203, 249), 1: RGB(75, 107, 169)])

# ---- group: house masses Viz
srf_2 = Surface(srf)
lng_2 = ListLength(List=srf_2)
random = Random(Range=Domain(3, 6), Number=lng_2, Seed=Slider(63, range=0..100), Integers=True)
Z = UnitZ(Factor=random)
extr = Extrude(Base=srf_2, Direction=Z)
sunion = SolidUnion(Breps=extr)

# ---- group: Thicken Streets
offcrv = OffsetCurve(
    Curve=L,
    Plane=PlaneXY(0, 0, 0),
    Distance=Slider(0.5, range=0..1),
    BothSides=invert(False),
    Kinks=Slider(1, range=0..3),
    CapType=Slider(0, range=0..3))
loft = Loft(Curves=offcrv, Options={Adjust=False, Closed=False, LoftEnds=0, LoftSimp=0, LoftType=0, Rebuild=10, Refit=0.01})  # -> flatten(Loft)

# ---- group: Border Circle Viz
cir = Circle(Plane=PlaneXY(0, 0, 0), Radius=R)
crv = Curve(cir)
pipe = Pipe(Curve=crv, Radius=Slider(0.1, range=0..1), Caps=0)

# ----
preview = CustomPreview(Geometry=sunion, Material=ColourSwatch(SwatchColor=RGB(255, 255, 237)))
preview_2 = CustomPreview(Geometry=pipe, Material=ColourSwatch(SwatchColor=RGB(255, 0, 0)))
preview_3 = CustomPreview(Geometry=loft, Material=gradient)

# ==== cluster Cluster
srf = ClusterInput()
M = ClusterInput()
srf_2 = ClusterInput()
srf_3 = Surface(srf)
srf_4 = Surface(srf_2)
preview = CustomPreview(Geometry=srf_3, Material=M)
lng = ListLength(List=srf_4)
random = Random(Range=Domain(4, 6), Number=lng, Seed=Slider(76, range=0..100), Integers=True)
Z = UnitZ(Factor=random)
extr = Extrude(Base=srf_4, Direction=Z)
preview_2 = CustomPreview(Geometry=extr, Material=ColourSwatch(SwatchColor=RGB(0, 0, 0)))
