# Grasshopper definition BR_localObs_Rhcompute_env.gh (Grasshopper 1.0.7)

# ---- group: RH_IN:action
int = Integer()

# ---- group: RH_IN:reset
bool = Boolean()

# ----
environment = GhPythonScript(action=int, reset=bool)  # -> out, simplify(grid_world), simplify(color_state), observation, reward, done, info; inputs action: Int32, reset: Boolean
# ---------- environment: Python ----------
"""Implementation of an RL environment class based on 
the 'Beady Ring' model (Hillier & Hanson, 1984).
    Inputs:
        x: The x script variable
        y: The y script variable
    Output:
        a: The a output variable"""

import random
from math import floor
import scriptcontext as sc
import ghpythonlib.components as ghcomp
import ghpythonlib.treehelpers as th


class BeadyRing_env:
    def __init__(self):
        self._carrier_color = 127.5
        self._house_color = 0
        self._street_color = 255
        self._cell_size = 3
        self._max_row_len = 36
        self._obs_size = 3
        self.pad = int(floor(self._obs_size/2))
        self.max_world_row_len = int(self._max_row_len + 2*self.pad)
        self.iter = 0
        
        # grid world
        xy_plane = ghcomp.XYPlane(ghcomp.ConstructPoint(0, 0, 0))
        cell, _ = ghcomp.Rectangle(xy_plane, self._cell_size, self._cell_size, 0)
        
        r_max = self._cell_size * self.max_world_row_len
        move_range = [i for i in range(0, r_max, self._cell_size)]
        
        y_vec = ghcomp.UnitY(move_range)
        cell_col, _ = ghcomp.Move(cell, y_vec)
        
        x_vec = ghcomp.UnitX(move_range)
        grid_world = []
        for c in cell_col:
            cell_row, _ = ghcomp.Move(c, x_vec)
            grid_world.append(cell_row)
        
        self.grid_world = ghcomp.ReverseList(grid_world)
        
        # initial location
        self.R = int(floor(self.max_world_row_len/2))
        self.C = int(floor(self.max_world_row_len/2))
        
        self.x = self.R - self.pad
        self.y = self.C - self.pad
        
        self.cell = [self.x, self.y]
        self.adjacent_cells = [[self.x, self.y]]
        self.adj_cells = [[self.x, self.y]]
        
        # initial state
        self.state = [[self._carrier_color for _ in range(int(self.max_world_row_len))] 
                        for _ in range(int(self.max_world_row_len))]
        
        # initial observation
        self.observation = self.get_obs()

    def step(self, _cell_state):
        self.iter += 1
        # update state step
        self.state[self.R][self.C] = 255*_cell_state
        
        for i, a in enumerate(self.adj_cells):
            if a == self.cell:
                del self.adj_cells[i]
        
        adjacent = self.get_adjacent()
        
        # reward
        reward = 0
        adj_street_count = 0
        
        for a in adjacent:
            if int(self.state[a[0] + self.pad][a[1] + self.pad]) == 255:
                adj_street_count += 1
        
        if _cell_state == 1:
            # density metric
            reward -= 1/(self._max_row_len**2)
            if adj_street_count >= 3:
                reward -= 1
            elif adj_street_count == 0:
                reward -= 1
        elif _cell_state == 0:
            if adj_street_count == 0:
                reward -= 1
            elif adj_street_count >= 3:
                reward -= 1
        
        for item in adjacent:
            if item not in self.adjacent_cells:
                self.adjacent_cells.append(item)
                self.adj_cells.append(item)
        
        # done
        done = False
        if len(self.adj_cells) == 0:
            done = True
        elif len(self.adj_cells) > 0:
            # next action location selection
            self.cell = random.choice(self.adj_cells)
            
            self.x = self.cell[0]
            self.y = self.cell[1]
            
            self.R = self.x + self.pad
            self.C = self.y + self.pad
        
        # observation
        self.observation = self.get_obs()
        
        return self.observation, reward, done, {}

    def reset(self):
        # initial state
        self.state = [[self._carrier_color for _ in range(int(self.max_world_row_len))] 
                        for _ in range(int(self.max_world_row_len))]
        
        # reset step counter
        self.iter = 0
        
        # initial location
        self.R = int(floor(self.max_world_row_len/2))
        self.C = int(floor(self.max_world_row_len/2))
        
        self.x = self.R - self.pad
        self.y = self.C - self.pad
        
        self.cell = [self.x, self.y]
        self.adjacent_cells = [[self.x, self.y]]
        self.adj_cells = [[self.x, self.y]]
        
        # initial observation
        self.observation = self.get_obs()
        
        return self.observation

    def render(self):
        # state visualization
        color_state = [ghcomp.ColourRGB(255, self.state[i], self.state[i], 
                        self.state[i]) for i in range(self.max_world_row_len)]
        return color_state

    def get_obs(self):
        # observation
        left_up_R = int(self.R - self.pad)
        left_up_C = int(self.C - self.pad)
        right_bottom_R = int(self.R + self.pad)
        right_bottom_C = int(self.C + self.pad)
        obs_ = []
        for i in range(left_up_R, right_bottom_R + 1):
            obs_row = []
            for j in range(left_up_C, right_bottom_C + 1):
                item = self.state[i][j]
                obs_row.append(item)
            obs_.append(obs_row)
        return obs_

    def get_adjacent(self):
        # von Neumann neighbourhood
        adjacent = []
        if self.x < self._max_row_len - 1:
            adjacent.append([self.x+1, self.y])
        if self.y > 0:
            adjacent.append([self.x, self.y-1])
        if self.x > 0:
            adjacent.append([self.x-1, self.y])
        if self.y < self._max_row_len - 1:
            adjacent.append([self.x, self.y+1])
        return adjacent

if 'env' not in globals():
    env = BeadyRing_env()
    sc.sticky['env'] = env

if reset:
    observation = sc.sticky['env'].reset()
    observation = th.list_to_tree(observation, source=[0,0])
    reward = None
    done = False
    info = {}
    grid_world_ = th.list_to_tree(sc.sticky['env'].grid_world, source=[0,0])
    color_state = sc.sticky['env'].render()
    color_state_ = th.list_to_tree(color_state, source=[0,0])
    
elif action is not None:
    observation, reward, done, info = sc.sticky['env'].step(action)
    observation = th.list_to_tree(observation, source=[0,0])
    reward = th.list_to_tree(reward, source=[0,0])
    done = th.list_to_tree(done, source=[0,0])
    info = th.list_to_tree(info, source=[0,0])
    grid_world_ = th.list_to_tree(sc.sticky['env'].grid_world, source=[0,0])
    color_state = sc.sticky['env'].render()
    color_state_ = th.list_to_tree(color_state, source=[0,0])
    
else:
    raise RuntimeError("Either reset or action must be provided")
# ---------- end environment ----------

# ---- group: RH_OUT:geo
geo = Geometry(environment.grid_world)

# ---- group: RH_OUT:color
num = Number(environment.color_state)

# ---- group: RH_OUT:observation
geo_2 = Geometry(environment.observation)

# ---- group: RH_OUT:reward
num_2 = Number(environment.reward)

# ---- group: RH_OUT:done
bool_2 = Boolean(environment.done)

# ---- group: RH_OUT:info
txt = Text(environment.info)
